# Grasshopper definition Anti_aliasing_study.gh (Grasshopper 1.0.8)
# plug-ins: RhinoCodePluginGH

number_slider = Slider(14.6, range=0..30)
pt = Point(<point referenced from the Rhino model>)
number_slider_2 = Slider(18, range=0..30)
number_slider_3 = Slider(3.4, range=0..30)
aa_ofset = Slider(0.6, range=0..30)
number_slider_4 = Slider(9.8, range=0..30)
number_slider_5 = Slider(18.9, range=0..30)
c_script = CSharpScript(
    center_pt=pt,
    cx=number_slider,
    cy=number_slider_2,
    radius=number_slider_3,
    offset=aa_ofset,
    test_px=number_slider_4,
    test_py=number_slider_5)  # -> out, a, b; inputs center_pt: Point3d, cx: Double, cy: Double, radius: Double, offset: Double, test_px: Double, test_py: Double
# ---------- c_script: C# ----------
// Grasshopper Script Instance
#region Usings
using System;
using System.Linq;
using System.Collections;
using System.Collections.Generic;
using System.Drawing;

using Rhino;
using Rhino.Geometry;
using uu;

using Grasshopper;
using Grasshopper.Kernel;
using Grasshopper.Kernel.Data;
using Grasshopper.Kernel.Types;
#endregion

public class Script_Instance : GH_ScriptInstance
{
    #region Notes
    /* 
      Members:
        RhinoDoc RhinoDocument
        GH_Document GrasshopperDocument
        IGH_Component Component
        int Iteration

      Methods (Virtual & overridable):
        Print(string text)
        Print(string format, params object[] args)
        Reflect(object obj)
        Reflect(object obj, string method_name)
    */
    #endregion

    private void RunScript(
	Point3d center_pt,
	double cx,
	double cy,
	double radius,
	double offset,
	double test_px,
	double test_py,
	ref object a,
	ref object b)
    {
        // Define Gh Visual Representation Reference.
        Circle cic = new Circle(new Point3d(cx,cy,0),radius);
        // double dx = Math.Sqrt((radius*radius) + (radius*radius));
        // Define Draw Area.
        Point3d[] pt_array = new Point3d[4];
        // AA Offset.
        double radius_offset = radius + offset;
        pt_array[0] = new Point3d(cx-radius_offset,cy-radius_offset,0);
        pt_array[1] = new Point3d(cx+radius_offset,cy-radius_offset,0);
        pt_array[2] = new Point3d(cx+radius_offset,cy+radius_offset,0);
        pt_array[3] = new Point3d(cx-radius_offset,cy+radius_offset,0);
        // Compute Dx and Dy.
        double dx = cx - test_px;
        double dy = cy - test_py; 
        double sqaured_distance = (dx * dx) +  (dy * dy);
        Console.WriteLine("Raw Distance -> {0}",Math.Sqrt(sqaured_distance));
        Console.WriteLine("Out Distance from Radius -> {0}",Math.Sqrt(sqaured_distance)-radius);
        double distance = Math.Clamp(offset - Math.Clamp(Math.Sqrt(sqaured_distance+(offset*2))-radius,0,offset),0.0,1.0);
        Console.WriteLine("Improved Alpha: -> {0}",1-Math.Clamp(remap.Remap(Math.Sqrt(sqaured_distance)-radius,0,offset,0,1.0),0,1.0));

    
        a = cic;
        b = pt_array;
    }
}
namespace uu{
    class remap{
static public double  Remap(double value, double fromMin, double fromMax, double toMin, double toMax)
{
    // Ensure fromMin != fromMax to avoid division by zero
    if (fromMin == fromMax)
    {
        throw new ArgumentException("Source range cannot have zero length");
    }
    return toMin + (value - fromMin) * (toMax - toMin) / (fromMax - fromMin);
}
    }
}
# ---------- end c_script ----------
panel = Panel(c_script.b)

pt_2 = ConstructPoint(XCoordinate=number_slider, YCoordinate=number_slider_2, ZCoordinate=0)
pt_3 = ConstructPoint(XCoordinate=number_slider_4, YCoordinate=number_slider_5, ZCoordinate=0)
addition = Addition(A=number_slider_3, B=aa_ofset)
cir = Circle(Plane=pt_2, Radius=addition)
ln = Line(StartPoint=pt_2, EndPoint=pt_3)

panel_2 = Panel([c_script.out, ln])
