# Grasshopper definition combined_matrix.gh (Grasshopper 1.0.8)

number_slider = Slider(4, range=0..4)
number_slider_2 = Slider(4, range=0..4)

# ---- group: two Input point
pt = ConstructPoint(XCoordinate=Slider(1, range=0..1), YCoordinate=Slider(1, range=0..1), ZCoordinate=Slider(0, range=0..1))
pt_2 = ConstructPoint(XCoordinate=Slider(1, range=0..1), YCoordinate=Slider(0, range=0..1), ZCoordinate=Slider(0, range=0..1))
pt_3 = Point([pt, pt_2])

# ----
panel = Panel("""1.0
0.0
0.0
-0.25
0.0
1.0
0.0
-0.25
0.0
0.0
1.0
0.0
0.0
0.0
0.0
1.0""")
panel_2 = Panel("""-1.0
0.0
0.0
0.0
0.0
1.0
0.0
0.0
0.0
0.0
1.0
0.0
0.0
0.0
0.0
1.0""")
matrix = ConstructMatrix(Rows=number_slider, Columns=number_slider, Values=panel_2)
matrix_2 = ConstructMatrix(Rows=number_slider_2, Columns=number_slider_2, Values=panel)

# ---- group: Rotate 90 deg left
rotate_90_left = DisplayMatrix(matrix)

# ---- group: Translation of -1/4 on (x,y)
rotate_90_left_2 = DisplayMatrix(matrix_2)

# ----
expression = Expression(pt=pt_2, Expression="(pt.X*-1.00)+(pt.Y*0.0)+(pt.Z*0.0)+(0.25*1.0)")
expression_2 = Expression(pt=pt_2, Expression="(pt.X*0.0)+(pt.Y*1.0)+(pt.Z*0.0)+(-0.25*1.0)")
expression_3 = Expression(pt=pt_2, Expression="(pt.X*0.0)+(pt.Y*0.0)+(pt.Z*1.0)+(0.0*1.0)")
expression_4 = Expression(pt=pt, Expression="(pt.X*-1.00)+(pt.Y*0.0)+(pt.Z*0.0)+(0.25*1.0)")
expression_5 = Expression(pt=pt, Expression="(pt.X*0.0)+(pt.Y*1.0)+(pt.Z*0.0)+(-0.25*1.0)")
expression_6 = Expression(pt=pt, Expression="(pt.X*0.0)+(pt.Y*0.0)+(pt.Z*1.0)+(0.0*1.0)")
pt_4 = ConstructPoint(XCoordinate=expression, YCoordinate=expression_2, ZCoordinate=expression_3)
pt_5 = ConstructPoint(XCoordinate=expression_4, YCoordinate=expression_5, ZCoordinate=expression_6)

# ---- group: Combined Transformation
multiplication = Multiplication(A=matrix, B=matrix_2)
display_matrix = DisplayMatrix(multiplication)

# ---- group: sum of the distributed product of the input point
transform = Transform(Geometry=pt_3, Transform=multiplication)

# ----
panel_3 = Panel(transform)
panel_4 = Panel([pt_5, pt_4])
